# Grasshopper definition Final-test-1-299.gh (Grasshopper 1.0.8)
# plug-ins: KUKA|prc - parametric robot control

# ---- group: Animace
robot = BooleanToggle(False)
tvarnice = Slider(1000, range=0..1000)

# ---- group: Simulation Point
X = Slider(600, range=-10000..10000)
Y = Slider(-100, range=-10000..10000)
Z = Slider(0, range=0..10000)
X_2 = Slider(4600, range=-10000..10000)
Y_2 = Slider(600, range=-10000..10000)
Z_2 = Slider(2750, range=0..10000)
X_3 = Slider(-100, range=-10000..10000)
Y_3 = Slider(-100, range=-10000..10000)
Z_3 = Slider(0, range=0..10000)
X_4 = Slider(600, range=-10000..10000)
Y_4 = Slider(4950, range=-10000..10000)
Z_4 = Slider(2750, range=0..10000)
number_points = Slider(10000, range=0..1000000)
pt = ConstructPoint(XCoordinate=X, YCoordinate=Y, ZCoordinate=Z)
pt_2 = ConstructPoint(XCoordinate=X_2, YCoordinate=Y_2, ZCoordinate=Z_2)
pt_3 = ConstructPoint(XCoordinate=X_3, YCoordinate=Y_3, ZCoordinate=Z_3)
pt_4 = ConstructPoint(XCoordinate=X_4, YCoordinate=Y_4, ZCoordinate=Z_4)
box = Box2Pt(PointA=pt_3, PointB=pt_4, Plane=PlaneXY(0, 0, 0))
box_2 = Box2Pt(PointA=pt, PointB=pt_2, Plane=PlaneXY(0, 0, 0))
pop3d = Populate3D(Region=[box, box_2], Count=number_points, Seed=1)
panel = Panel(pop3d)

# ---- group: Poloviční tvarovka
výška_tvarovky = Slider(250, range=-10000..10000)
hloubka_drážky = Slider(50, range=0..500)
šířka_tvarovky = Slider(440, range=-10000..10000)
délka_tvarovky = Slider(125, range=-10000..10000)
délka_drážky = Slider(150, range=0..500)
division = Division(A=šířka_tvarovky, B=-2)
division_2 = Division(A=šířka_tvarovky, B=2)
division_3 = Division(A=délka_tvarovky, B=-2)
division_4 = Division(A=délka_tvarovky, B=2)
division_5 = Division(A=hloubka_drážky, B=-2)
division_6 = Division(A=hloubka_drážky, B=2)
division_7 = Division(A=délka_drážky, B=-2)
division_8 = Division(A=délka_drážky, B=2)
construct_domain = ConstructDomain(DomainStart=division, DomainEnd=division_2)
construct_domain_2 = ConstructDomain(DomainStart=division_3, DomainEnd=division_4)
construct_domain_3 = ConstructDomain(DomainStart=division_7, DomainEnd=division_8)
construct_domain_4 = ConstructDomain(DomainStart=division_5, DomainEnd=division_6)
podstavec = Rectangle(Plane=PlaneXY(0, 0, 0), XSize=construct_domain_3, YSize=construct_domain_4, Radius=0)  # -> Rectangle, Length
division_9 = Division(A=délka_tvarovky, B=-2)
podstavec_2 = Rectangle(Plane=PlaneXY(0, 0, 0), XSize=construct_domain, YSize=construct_domain_2, Radius=0)  # -> Rectangle, Length
unit_z = UnitZ(Factor=výška_tvarovky)
addition = Addition(A=division_9, B=division_6)
extrude = Extrude(Base=podstavec.Rectangle, Direction=unit_z)
extrude_2 = Extrude(Base=podstavec_2.Rectangle, Direction=unit_z)
unit_y = UnitY(Factor=addition)
move = Move(Geometry=extrude, Motion=unit_y)  # -> Geometry, Transform
cap_holes_ex = CapHolesEx(Brep=extrude_2)  # -> Brep, Caps, Solid
cap_holes_ex_2 = CapHolesEx(Brep=move.Geometry)  # -> Brep, Caps, Solid
solid_difference = SolidDifference(BrepsA=cap_holes_ex.Brep, BrepsB=cap_holes_ex_2.Brep)

# ---- group: Materialy
concrete = Panel("./Texture/Conc dark gray.rmtl")
wood_material = Panel("./Texture/Oak light.rmtl")
actual_point = Panel("./Texture/Granite light.rmtl")
brick_material = Panel("./Texture/masonrytexture sandstone colored y5332.rmtl")
brick_material_r = Panel("./Texture/masonrytexture sandstone colored pattern y5440.rmtl")
brick_material_k_2 = Panel("./Texture/masonrytexture sandstone colored y5330.rmtl")
brick_material_k = Panel("./Texture/masonrytexture sandstone colored y5331.rmtl")
souhrn_material = Panel([brick_material, brick_material_r, brick_material_k_2, brick_material_k])

# ---- group: Koncová tvarovka
délka_tvarovky_2 = Slider(250, range=-10000..10000)
výška_tvarovky_2 = Slider(250, range=-10000..10000)
hloubka_drážky_2 = Slider(50, range=0..500)
šířka_tvarovky_2 = Slider(440, range=-10000..10000)
délka_drážky_2 = Slider(150, range=0..500)
division_10 = Division(A=šířka_tvarovky_2, B=-2)
division_11 = Division(A=šířka_tvarovky_2, B=2)
division_12 = Division(A=délka_tvarovky_2, B=-2)
division_13 = Division(A=délka_tvarovky_2, B=2)
division_14 = Division(A=hloubka_drážky_2, B=-2)
division_15 = Division(A=hloubka_drážky_2, B=2)
division_16 = Division(A=délka_drážky_2, B=-2)
division_17 = Division(A=délka_drážky_2, B=2)
construct_domain_5 = ConstructDomain(DomainStart=division_10, DomainEnd=division_11)
construct_domain_6 = ConstructDomain(DomainStart=division_12, DomainEnd=division_13)
construct_domain_7 = ConstructDomain(DomainStart=division_16, DomainEnd=division_17)
construct_domain_8 = ConstructDomain(DomainStart=division_14, DomainEnd=division_15)
podstavec_3 = Rectangle(Plane=PlaneXY(0, 0, 0), XSize=construct_domain_7, YSize=construct_domain_8, Radius=0)  # -> Rectangle, Length
division_18 = Division(A=délka_tvarovky_2, B=-2)
podstavec_4 = Rectangle(Plane=PlaneXY(0, 0, 0), XSize=construct_domain_5, YSize=construct_domain_6, Radius=0)  # -> Rectangle, Length
unit_z_2 = UnitZ(Factor=výška_tvarovky_2)
addition_2 = Addition(A=division_18, B=division_15)
extrude_3 = Extrude(Base=podstavec_3.Rectangle, Direction=unit_z_2)
extrude_4 = Extrude(Base=podstavec_4.Rectangle, Direction=unit_z_2)
unit_y_2 = UnitY(Factor=addition_2)
cap_holes_ex_3 = CapHolesEx(Brep=extrude_4)  # -> Brep, Caps, Solid
move_2 = Move(Geometry=extrude_3, Motion=unit_y_2)  # -> Geometry, Transform
cap_holes_ex_4 = CapHolesEx(Brep=move_2.Geometry)  # -> Brep, Caps, Solid
solid_difference_2 = SolidDifference(BrepsA=cap_holes_ex_3.Brep, BrepsB=cap_holes_ex_4.Brep)

# ---- group: Rohová tvarovka
délka_tvarovky_3 = Slider(190, range=-10000..10000)
výška_tvarovky_3 = Slider(250, range=-10000..10000)
šířka_tvarovky_3 = Slider(440, range=-10000..10000)
division_19 = Division(A=šířka_tvarovky_3, B=-2)
division_20 = Division(A=šířka_tvarovky_3, B=2)
division_21 = Division(A=délka_tvarovky_3, B=-2)
division_22 = Division(A=délka_tvarovky_3, B=2)
construct_domain_9 = ConstructDomain(DomainStart=division_19, DomainEnd=division_20)
construct_domain_10 = ConstructDomain(DomainStart=division_21, DomainEnd=division_22)
podstavec_5 = Rectangle(Plane=PlaneXY(0, 0, 0), XSize=construct_domain_9, YSize=construct_domain_10, Radius=0)  # -> Rectangle, Length
unit_z_3 = UnitZ(Factor=výška_tvarovky_3)
extrude_5 = Extrude(Base=podstavec_5.Rectangle, Direction=unit_z_3)
cap_holes_ex_5 = CapHolesEx(Brep=extrude_5)  # -> Brep, Caps, Solid

# ---- group: Základní tvarovka
délka_tvarovky_4 = Slider(250, range=-10000..10000)
výška_tvarovky_4 = Slider(250, range=-10000..10000)
šířka_tvarovky_4 = Slider(440, range=-10000..10000)
division_23 = Division(A=šířka_tvarovky_4, B=-2)
division_24 = Division(A=šířka_tvarovky_4, B=2)
division_25 = Division(A=délka_tvarovky_4, B=-2)
division_26 = Division(A=délka_tvarovky_4, B=2)
construct_domain_11 = ConstructDomain(DomainStart=division_23, DomainEnd=division_24)
construct_domain_12 = ConstructDomain(DomainStart=division_25, DomainEnd=division_26)
podstavec_6 = Rectangle(Plane=PlaneXY(0, 0, 0), XSize=construct_domain_11, YSize=construct_domain_12, Radius=0)  # -> Rectangle, Length
unit_z_4 = UnitZ(Factor=výška_tvarovky_4)
extrude_6 = Extrude(Base=podstavec_6.Rectangle, Direction=unit_z_4)
cap_holes_ex_6 = CapHolesEx(Brep=extrude_6)  # -> Brep, Caps, Solid

# ---- group: Start figury
x_start = Slider(0, range=-10000..10000)
y_start = Slider(0, range=-10000..10000)
z_start = Slider(0, range=-10000..10000)
negative = Negative(Value=z_start)
negative_2 = Negative(Value=x_start)
negative_3 = Negative(Value=y_start)
construct_point = ConstructPoint(XCoordinate=negative_2, YCoordinate=negative_3, ZCoordinate=negative)

# ---- group: Koty
construct_point_2 = ConstructPoint(XCoordinate=0, YCoordinate=100, ZCoordinate=0)
construct_point_3 = ConstructPoint(XCoordinate=2400, YCoordinate=100, ZCoordinate=0)
distance = Distance(PointA=construct_point_2, PointB=construct_point_3)
aligned_dimension = AlignedDimension(Plane=PlaneXY(0, 0, 0), PointA=construct_point_2, PointB=construct_point_3, Offset=1, Text=distance, Size=50)

# ---- group: Model Stěny
read_file = ReadFile(File="./Data/Tvarnice-1-299.csv", PerLineParse=True)
text_split = TextSplit(Text=read_file, Separators=";")
flip_matrix = FlipMatrix(Data=text_split)
explode_tree = ExplodeTree(Data=flip_matrix)  # -> Branch0, Branch1, Branch2, Branch3, Branch4, Branch5, Branch6, Branch7
list_length = ListLength(List=explode_tree.Branch1)
series = Series(Start=1, Step=1, Count=list_length)
vrstva = Data(explode_tree.Branch6)
tvarovka_na_paletě = Data(explode_tree.Branch7)
druh_tvarovky = Data(explode_tree.Branch1)
pootočení = Data(explode_tree.Branch2)
x_střed = Data(explode_tree.Branch3)
y_střed = Data(explode_tree.Branch4)
z_střed = Data(explode_tree.Branch5)
přísavka = Data(explode_tree.Branch7)
pořadí = Data(explode_tree.Branch0)
construct_point_4 = ConstructPoint(XCoordinate=x_střed, YCoordinate=y_střed, ZCoordinate=z_střed)
brep = Brep([cap_holes_ex_6.Brep, cap_holes_ex_5.Brep, solid_difference, solid_difference_2])
subtraction = Subtraction(A=druh_tvarovky, B=1)
addition_3 = Addition(A=pootočení, B=270)
radians = Radians(Degrees=addition_3)
list_item = ListItem(List=brep, Index=subtraction, Wrap=True)
vector_2pt = Vector2Pt(PointA=construct_point, PointB=construct_point_4, Unitize=False)  # -> Vector, Length
rotate = Rotate(Geometry=list_item, Angle=radians, Plane=PlaneXY(0, 0, 0))  # -> Geometry, Transform
move_3 = Move(Geometry=vector_2pt.Vector, Motion=Vector(0, 0, 100))  # -> Geometry, Transform
move_4 = Move(Geometry=rotate.Geometry, Motion=vector_2pt.Vector)  # -> Geometry, Transform
zacatek_vrstvy = Slider(1, range=1..1000)
konec_vrstvy = Slider(299, range=1..1000)
split_list = SplitList(List=move_4.Geometry, Index=tvarnice)  # -> Geometrie, ListB
split_list_2 = SplitList(List=move_3.Geometry, Index=tvarnice)  # -> TagLocation, ListB
split_list_3 = SplitList(List=druh_tvarovky, Index=tvarnice)  # -> DruhTvarovky, ListB
panel_2 = Panel(split_list_3.DruhTvarovky)
split_list_4 = SplitList(List=pořadí, Index=tvarnice)  # -> TagText, ListB
concatenate = Concatenate(FragmentA=split_list_4.TagText, FragmentB="-", FragmentC=tvarovka_na_paletě)
sort_list = SortList(Keys=split_list_3.DruhTvarovky)  # -> flatten(Keys), ValuesValuesA
subtraction_2 = Subtraction(A=zacatek_vrstvy, B=1)
subtraction_3 = Subtraction(A=konec_vrstvy, B=1)
construct_domain_13 = ConstructDomain(DomainStart=subtraction_2, DomainEnd=subtraction_3)
sub_list = SubList(List=subtraction, Domain=construct_domain_13, Wrap=True)  # -> List, Index
list_item_2 = ListItem(List=souhrn_material, Index=sub_list.List, Wrap=True)
sub_list_2 = SubList(List=split_list_2.TagLocation, Domain=construct_domain_13, Wrap=True)  # -> List, Index
sub_list_3 = SubList(List=concatenate, Domain=construct_domain_13, Wrap=True)  # -> List, Index
text_tag = TextTag(Location=sub_list_2.List, Text=sub_list_3.List, Colour=RGB(0, 0, 0))
create_set = CreateSet(List=sort_list.Keys)  # -> Set, Map
panel_3 = Panel(create_set.Set)
equality = Equality(FirstNumber=split_list_3.DruhTvarovky, SecondNumber=1)  # -> Equality, Inequality
equality_2 = Equality(FirstNumber=split_list_3.DruhTvarovky, SecondNumber=3)  # -> Equality, Inequality
equality_3 = Equality(FirstNumber=split_list_3.DruhTvarovky, SecondNumber=2)  # -> Equality, Inequality
equality_4 = Equality(FirstNumber=split_list_3.DruhTvarovky, SecondNumber=4)  # -> Equality, Inequality
create_set_2 = CreateSet(List=create_set.Map)  # -> Set, Map
sub_list_4 = SubList(List=split_list.Geometrie, Domain=construct_domain_13, Wrap=True)  # -> List, Index
member_index = MemberIndex(Set=create_set.Map, Member=create_set_2.Set)  # -> Index, Count
mass_addition = MassAddition(Input=equality.Equality)  # -> Result, PartialResults
mass_addition_2 = MassAddition(Input=equality_2.Equality)  # -> Result, PartialResults
mass_addition_3 = MassAddition(Input=equality_3.Equality)  # -> Result, PartialResults
mass_addition_4 = MassAddition(Input=equality_4.Equality)  # -> Result, PartialResults
počet_tvarovek = Panel(member_index.Count)
stream_gate = StreamGate(Stream=sub_list_4.List, Gate=robot)  # -> Target0, Target1
replace_nulls = ReplaceNulls(Items=mass_addition.Result, Replacements=0)  # -> Items, Count
replace_nulls_2 = ReplaceNulls(Items=mass_addition_3.Result, Replacements=0)  # -> Items, Count
replace_nulls_3 = ReplaceNulls(Items=mass_addition_2.Result, Replacements=0)  # -> Items, Count
replace_nulls_4 = ReplaceNulls(Items=mass_addition_4.Result, Replacements=0)  # -> Items, Count
custom_preview = CustomPreview(Geometry=stream_gate.Target0, Material=list_item_2)

# ---- group: Paleta 3 - Doplňkové tvarovky
x_paleta_1 = Slider(2000, range=-10000..10000)
y_paleta_1 = Slider(4500, range=-10000..10000)
z_paleta_1 = Slider(500, range=0..10000)
délka_palety_1 = Slider(1320, range=0..10000)
výška_palety_1 = Slider(144, range=0..10000)
šířka_palety_1 = Slider(1000, range=0..10000)
počet_prvků_z = Slider(3, range=0..20)
počet_prvků_x = Slider(1, range=0..20)
počet_prvků_y = Slider(5, range=0..20)
brep_2 = Brep(cap_holes_ex_5.Brep)
počet_prvků_z_2 = Slider(3, range=0..20)
počet_prvků_x_2 = Slider(1, range=0..20)
počet_prvků_y_2 = Slider(4, range=0..20)
počet_prvků_z_3 = Slider(2, range=0..20)
počet_prvků_x_3 = Slider(1, range=0..20)
počet_prvků_y_3 = Slider(5, range=0..20)
brep_3 = Brep(solid_difference_2)
brep_4 = Brep(solid_difference)
střed_palety_1 = ConstructPoint(XCoordinate=x_paleta_1, YCoordinate=y_paleta_1, ZCoordinate=z_paleta_1)
division_27 = Division(A=délka_palety_1, B=-2)
division_28 = Division(A=délka_palety_1, B=2)
division_29 = Division(A=šířka_palety_1, B=-2)
division_30 = Division(A=šířka_palety_1, B=2)
construct_domain_14 = ConstructDomain(DomainStart=division_27, DomainEnd=division_28)
construct_domain_15 = ConstructDomain(DomainStart=division_29, DomainEnd=division_30)
robot_2 = Rectangle(Plane=střed_palety_1, XSize=construct_domain_14, YSize=construct_domain_15, Radius=0)  # -> Rectangle, Length
unit_z_5 = UnitZ(Factor=výška_palety_1)
extrude_7 = Extrude(Base=robot_2.Rectangle, Direction=unit_z_5)
deconstruct_brep = DeconstructBrep(Brep=brep_2)  # -> Faces, Edges, Vertices
length = Length(Curve=deconstruct_brep.Edges)
length_2 = Length(Curve=deconstruct_brep.Edges)
length_3 = Length(Curve=deconstruct_brep.Edges)
truncate = Truncate(Input=length, TruncationFactor=0)
truncate_2 = Truncate(Input=length_2, TruncationFactor=0)  # -> reverse(Result)
truncate_3 = Truncate(Input=length_3, TruncationFactor=0)  # -> reverse(Result)
sub_list_5 = SubList(List=truncate, Domain=Domain(5, 5), Wrap=True)  # -> List, Index
subtraction_4 = Subtraction(A=počet_prvků_z, B=1)
subtraction_5 = Subtraction(A=počet_prvků_z_3, B=1)
subtraction_6 = Subtraction(A=počet_prvků_z_2, B=1)
sub_list_6 = SubList(List=truncate_2, Domain=Domain(0, 0), Wrap=True)  # -> List, Index
deconstruct_brep_2 = DeconstructBrep(Brep=brep_3)  # -> Faces, Edges, Vertices
length_4 = Length(Curve=deconstruct_brep_2.Edges)
truncate_4 = Truncate(Input=length_4, TruncationFactor=0)
sub_list_7 = SubList(List=truncate_4, Domain=Domain(20, 20), Wrap=True)  # -> List, Index
deconstruct_brep_3 = DeconstructBrep(Brep=brep_4)  # -> Faces, Edges, Vertices
length_5 = Length(Curve=deconstruct_brep_3.Edges)
truncate_5 = Truncate(Input=length_5, TruncationFactor=0)
sub_list_8 = SubList(List=truncate_5, Domain=Domain(20, 20), Wrap=True)  # -> List, Index
sub_list_9 = SubList(List=truncate_3, Domain=Domain(0, 0), Wrap=True)  # -> List, Index
sort_points = SortPoints(Points=deconstruct_brep.Vertices)  # -> Points, Indices
cap_holes_ex_7 = CapHolesEx(Brep=extrude_7)  # -> Brep, Caps, Solid
deconstruct_brep_4 = DeconstructBrep(Brep=cap_holes_ex_7.Brep)  # -> Faces, Edges, Vertices
sort_points_2 = SortPoints(Points=deconstruct_brep_4.Vertices)  # -> Points, Indices
multiplication = Multiplication(A=sub_list_5.List, B=subtraction_4)
multiplication_2 = Multiplication(A=sub_list_8.List, B=subtraction_5)
multiplication_3 = Multiplication(A=sub_list_7.List, B=subtraction_6)
negative_4 = Negative(Value=počet_prvků_z)
negative_5 = Negative(Value=počet_prvků_x)
multiplication_4 = Multiplication(A=sub_list_6.List, B=2)
sort_points_3 = SortPoints(Points=deconstruct_brep_2.Vertices)  # -> Points, Indices
sort_points_4 = SortPoints(Points=deconstruct_brep_3.Vertices)  # -> Points, Indices
negative_6 = Negative(Value=počet_prvků_z_3)
negative_7 = Negative(Value=počet_prvků_x_3)
unit_x = UnitX(Factor=sub_list_9.List)
negative_8 = Negative(Value=počet_prvků_x_2)
negative_9 = Negative(Value=počet_prvků_z_2)
unit_z_6 = UnitZ(Factor=multiplication)
sub_list_10 = SubList(List=sort_points_2.Points, Domain=Domain(1, 1), Wrap=True)  # -> List, Index
sub_list_11 = SubList(List=sort_points.Points, Domain=Domain(0, 0), Wrap=True)  # -> List, Index
unit_z_7 = UnitZ(Factor=multiplication_2)
unit_z_8 = UnitZ(Factor=multiplication_3)
unit_x_2 = UnitX(Factor=multiplication_4)
custom_preview_2 = CustomPreview(Geometry=cap_holes_ex_7.Brep, Material=wood_material)
sub_list_12 = SubList(List=sort_points_3.Points, Domain=Domain(0, 0), Wrap=True)  # -> List, Index
sub_list_13 = SubList(List=sort_points_4.Points, Domain=Domain(0, 0), Wrap=True)  # -> List, Index
vector_2pt_2 = Vector2Pt(PointA=sub_list_11.List, PointB=sub_list_10.List, Unitize=False)  # -> Vector, Length
move_5 = Move(Geometry=brep_2, Motion=unit_z_6)  # -> Geometry, Transform
move_6 = Move(Geometry=brep_4, Motion=unit_z_7)  # -> Geometry, Transform
move_7 = Move(Geometry=move_6.Geometry, Motion=unit_x)  # -> Geometry, Transform
move_8 = Move(Geometry=brep_3, Motion=unit_z_8)  # -> Geometry, Transform
move_9 = Move(Geometry=move_5.Geometry, Motion=unit_x_2)  # -> Geometry, Transform
vector_2pt_3 = Vector2Pt(PointA=sub_list_13.List, PointB=sub_list_10.List, Unitize=False)  # -> Vector, Length
vector_2pt_4 = Vector2Pt(PointA=sub_list_12.List, PointB=sub_list_10.List, Unitize=False)  # -> Vector, Length
move_10 = Move(Geometry=move_7.Geometry, Motion=vector_2pt_3.Vector)  # -> Geometry, Transform
move_11 = Move(Geometry=move_9.Geometry, Motion=vector_2pt_2.Vector)  # -> Geometry, Transform
move_12 = Move(Geometry=move_8.Geometry, Motion=vector_2pt_4.Vector)  # -> Geometry, Transform
box_array = BoxArray(Geometry=move_11.Geometry, Cell=brep_2, XCount=negative_5, YCount=počet_prvků_y, ZCount=negative_4)  # -> Geometry, Transform
list_length_2 = ListLength(List=box_array.Geometry)
evaluate_box = EvaluateBox(Box=box_array.Geometry, UParameter=0.5, VParameter=0.5, WParameter=0.5)  # -> Plane, Point, Include
series_2 = Series(Start=1, Step=1, Count=list_length_2)
box_array_2 = BoxArray(Geometry=move_10.Geometry, Cell=brep_4, XCount=negative_7, YCount=počet_prvků_y_3, ZCount=negative_6)  # -> Geometry, Transform
list_length_3 = ListLength(List=box_array_2.Geometry)
box_array_3 = BoxArray(Geometry=move_12.Geometry, Cell=brep_3, XCount=negative_8, YCount=počet_prvků_y_2, ZCount=negative_9)  # -> Geometry, Transform
text_tag_2 = TextTag(Location=evaluate_box.Point, Text=series_2, Colour=RGB(56, 54, 255))
evaluate_box_2 = EvaluateBox(Box=box_array_2.Geometry, UParameter=0.5, VParameter=0.5, WParameter=0.5)  # -> Plane, Point, Include
series_3 = Series(Start=1, Step=1, Count=list_length_3)
split_list_5 = SplitList(List=box_array.Geometry, Index=replace_nulls_2.Items)  # -> OdebránéTvarnice, TvarniceNaPaletě
split_list_6 = SplitList(List=box_array_2.Geometry, Index=replace_nulls_3.Items)  # -> OdebránéTvarnice, TvarniceNaPaletě
text_tag_3 = TextTag(Location=evaluate_box_2.Point, Text=series_3, Colour=RGB(56, 54, 255))
custom_preview_3 = CustomPreview(Geometry=box_array_2.Geometry, Material=brick_material_k_2)
custom_preview_4 = CustomPreview(Geometry=box_array.Geometry, Material=brick_material_r)

# ---- group: Paleta 4 - Doplňkové tvarovky
x_paleta_1_2 = Slider(2000, range=-10000..10000)
y_paleta_1_2 = Slider(-1750, range=-10000..10000)
z_paleta_1_2 = Slider(0, range=0..10000)
délka_palety_1_2 = Slider(1320, range=0..10000)
výška_palety_1_2 = Slider(144, range=0..10000)
šířka_palety_1_2 = Slider(1000, range=0..10000)
počet_prvků_z_4 = Slider(0, range=0..20)
počet_prvků_x_4 = Slider(1, range=0..20)
počet_prvků_y_4 = Slider(4, range=0..20)
brep_5 = Brep(solid_difference_2)
střed_palety_1_2 = ConstructPoint(XCoordinate=x_paleta_1_2, YCoordinate=y_paleta_1_2, ZCoordinate=z_paleta_1_2)
division_31 = Division(A=délka_palety_1_2, B=-2)
division_32 = Division(A=délka_palety_1_2, B=2)
division_33 = Division(A=šířka_palety_1_2, B=-2)
division_34 = Division(A=šířka_palety_1_2, B=2)
construct_domain_16 = ConstructDomain(DomainStart=division_31, DomainEnd=division_32)
construct_domain_17 = ConstructDomain(DomainStart=division_33, DomainEnd=division_34)
robot_3 = Rectangle(Plane=střed_palety_1_2, XSize=construct_domain_16, YSize=construct_domain_17, Radius=0)  # -> Rectangle, Length
unit_z_9 = UnitZ(Factor=výška_palety_1_2)
extrude_8 = Extrude(Base=robot_3.Rectangle, Direction=unit_z_9)
subtraction_7 = Subtraction(A=počet_prvků_z_4, B=1)
deconstruct_brep_5 = DeconstructBrep(Brep=brep_5)  # -> Faces, Edges, Vertices
length_6 = Length(Curve=deconstruct_brep_5.Edges)
truncate_6 = Truncate(Input=length_6, TruncationFactor=0)
sub_list_14 = SubList(List=truncate_6, Domain=Domain(20, 20), Wrap=True)  # -> List, Index
negative_10 = Negative(Value=počet_prvků_x_4)
negative_11 = Negative(Value=počet_prvků_z_4)
multiplication_5 = Multiplication(A=sub_list_14.List, B=subtraction_7)
sort_points_5 = SortPoints(Points=deconstruct_brep_5.Vertices)  # -> Points, Indices
cap_holes_ex_8 = CapHolesEx(Brep=extrude_8)  # -> Brep, Caps, Solid
deconstruct_brep_6 = DeconstructBrep(Brep=cap_holes_ex_8.Brep)  # -> Faces, Edges, Vertices
sort_points_6 = SortPoints(Points=deconstruct_brep_6.Vertices)  # -> Points, Indices
unit_z_10 = UnitZ(Factor=multiplication_5)
sub_list_15 = SubList(List=sort_points_6.Points, Domain=Domain(1, 1), Wrap=True)  # -> List, Index
sub_list_16 = SubList(List=sort_points_5.Points, Domain=Domain(0, 0), Wrap=True)  # -> List, Index
custom_preview_5 = CustomPreview(Geometry=cap_holes_ex_8.Brep, Material=wood_material)
move_13 = Move(Geometry=brep_5, Motion=unit_z_10)  # -> Geometry, Transform
vector_2pt_5 = Vector2Pt(PointA=sub_list_16.List, PointB=sub_list_15.List, Unitize=False)  # -> Vector, Length
move_14 = Move(Geometry=move_13.Geometry, Motion=vector_2pt_5.Vector)  # -> Geometry, Transform
box_array_4 = BoxArray(Geometry=move_14.Geometry, Cell=brep_5, XCount=negative_10, YCount=počet_prvků_y_4, ZCount=negative_11)  # -> Geometry, Transform
merge = Merge(Data1=box_array_3.Geometry, Data2=box_array_4.Geometry)  # -> flatten(Result)
list_length_4 = ListLength(List=merge)
evaluate_box_3 = EvaluateBox(Box=merge, UParameter=0.5, VParameter=0.5, WParameter=0.5)  # -> Plane, Point, Include
series_4 = Series(Start=1, Step=1, Count=list_length_4)
split_list_7 = SplitList(List=merge, Index=replace_nulls_4.Items)  # -> OdebránéTvarnice, TvarniceNaPaletě
text_tag_4 = TextTag(Location=evaluate_box_3.Point, Text=series_4, Colour=RGB(56, 54, 255))
custom_preview_6 = CustomPreview(Geometry=merge, Material=brick_material_k)

# ---- group: Paleta 1 - Základní tvarovky
x_paleta_1_3 = Slider(3500, range=-10000..10000)
y_paleta_1_3 = Slider(4500, range=-10000..10000)
z_paleta_1_3 = Slider(0, range=0..10000)
délka_palety_1_3 = Slider(1320, range=0..10000)
výška_palety_1_3 = Slider(144, range=0..10000)
šířka_palety_1_3 = Slider(1000, range=0..10000)
počet_prvků_z_5 = Slider(5, range=0..20)
počet_prvků_x_5 = Slider(3, range=0..20)
počet_prvků_y_5 = Slider(4, range=0..20)
brep_6 = Brep(cap_holes_ex_6.Brep)
střed_palety_1_3 = ConstructPoint(XCoordinate=x_paleta_1_3, YCoordinate=y_paleta_1_3, ZCoordinate=z_paleta_1_3)
division_35 = Division(A=délka_palety_1_3, B=-2)
division_36 = Division(A=délka_palety_1_3, B=2)
division_37 = Division(A=šířka_palety_1_3, B=-2)
division_38 = Division(A=šířka_palety_1_3, B=2)
construct_domain_18 = ConstructDomain(DomainStart=division_35, DomainEnd=division_36)
construct_domain_19 = ConstructDomain(DomainStart=division_37, DomainEnd=division_38)
robot_4 = Rectangle(Plane=střed_palety_1_3, XSize=construct_domain_18, YSize=construct_domain_19, Radius=0)  # -> Rectangle, Length
unit_z_11 = UnitZ(Factor=výška_palety_1_3)
extrude_9 = Extrude(Base=robot_4.Rectangle, Direction=unit_z_11)
subtraction_8 = Subtraction(A=počet_prvků_x_5, B=1)
deconstruct_brep_7 = DeconstructBrep(Brep=brep_6)  # -> Faces, Edges, Vertices
length_7 = Length(Curve=deconstruct_brep_7.Edges)
length_8 = Length(Curve=deconstruct_brep_7.Edges)
truncate_7 = Truncate(Input=length_7, TruncationFactor=0)
truncate_8 = Truncate(Input=length_8, TruncationFactor=0)  # -> reverse(Result)
sub_list_17 = SubList(List=truncate_7, Domain=Domain(5, 5), Wrap=True)  # -> List, Index
sub_list_18 = SubList(List=truncate_8, Domain=Domain(0, 0), Wrap=True)  # -> List, Index
subtraction_9 = Subtraction(A=počet_prvků_z_5, B=1)
sort_points_7 = SortPoints(Points=deconstruct_brep_7.Vertices)  # -> Points, Indices
multiplication_6 = Multiplication(A=sub_list_18.List, B=subtraction_8)
multiplication_7 = Multiplication(A=sub_list_17.List, B=subtraction_9)
cap_holes_ex_9 = CapHolesEx(Brep=extrude_9)  # -> Brep, Caps, Solid
deconstruct_brep_8 = DeconstructBrep(Brep=cap_holes_ex_9.Brep)  # -> Faces, Edges, Vertices
sort_points_8 = SortPoints(Points=deconstruct_brep_8.Vertices)  # -> Points, Indices
unit_x_3 = UnitX(Factor=multiplication_6)
unit_z_12 = UnitZ(Factor=multiplication_7)
sub_list_19 = SubList(List=sort_points_8.Points, Domain=Domain(1, 1), Wrap=True)  # -> List, Index
sub_list_20 = SubList(List=sort_points_7.Points, Domain=Domain(0, 0), Wrap=True)  # -> List, Index
custom_preview_7 = CustomPreview(Geometry=cap_holes_ex_9.Brep, Material=wood_material)
negative_12 = Negative(Value=počet_prvků_z_5)
negative_13 = Negative(Value=počet_prvků_x_5)
move_15 = Move(Geometry=brep_6, Motion=unit_z_12)  # -> Geometry, Transform
move_16 = Move(Geometry=move_15.Geometry, Motion=unit_x_3)  # -> Geometry, Transform
vector_2pt_6 = Vector2Pt(PointA=sub_list_20.List, PointB=sub_list_19.List, Unitize=False)  # -> Vector, Length
move_17 = Move(Geometry=move_16.Geometry, Motion=vector_2pt_6.Vector)  # -> Geometry, Transform
box_array_5 = BoxArray(Geometry=move_17.Geometry, Cell=brep_6, XCount=negative_13, YCount=počet_prvků_y_5, ZCount=negative_12)  # -> Geometry, Transform
list_length_5 = ListLength(List=box_array_5.Geometry)
evaluate_box_4 = EvaluateBox(Box=box_array_5.Geometry, UParameter=0.5, VParameter=0.5, WParameter=0.5)  # -> Plane, Point, Include
series_5 = Series(Start=1, Step=1, Count=list_length_5)
text_tag_5 = TextTag(Location=evaluate_box_4.Point, Text=series_5, Colour=RGB(56, 54, 255))
split_list_8 = SplitList(List=box_array_5.Geometry, Index=replace_nulls.Items)  # -> OdebránéTvarnice, TvarniceNaPaletě
custom_preview_8 = CustomPreview(Geometry=box_array_5.Geometry, Material=brick_material)

# ---- group: Prvky na palete
subtraction_10 = Subtraction(A=pořadí, B=1)
subtraction_11 = Subtraction(A=tvarovka_na_paletě, B=1)
dispatch = Dispatch(List=subtraction_10, DispatchPattern=equality.Equality)  # -> ListA, ListB
dispatch_2 = Dispatch(List=subtraction_10, DispatchPattern=equality_3.Equality)  # -> ListA, ListB
dispatch_3 = Dispatch(List=subtraction_10, DispatchPattern=equality_2.Equality)  # -> ListA, ListB
dispatch_4 = Dispatch(List=subtraction_10, DispatchPattern=equality_4.Equality)  # -> ListA, ListB
dispatch_5 = Dispatch(List=subtraction_11, DispatchPattern=equality.Equality)  # -> ListA, ListB
dispatch_6 = Dispatch(List=subtraction_11, DispatchPattern=equality_3.Equality)  # -> ListA, ListB
dispatch_7 = Dispatch(List=subtraction_11, DispatchPattern=equality_2.Equality)  # -> ListA, ListB
dispatch_8 = Dispatch(List=subtraction_11, DispatchPattern=equality_4.Equality)  # -> ListA, ListB
list_item_3 = ListItem(List=box_array_2.Geometry, Index=dispatch_7.ListA, Wrap=True)
list_item_4 = ListItem(List=box_array.Geometry, Index=dispatch_6.ListA, Wrap=True)
list_item_5 = ListItem(List=merge, Index=dispatch_8.ListA, Wrap=True)
list_item_6 = ListItem(List=box_array_5.Geometry, Index=dispatch_5.ListA, Wrap=True)
replace_items = ReplaceItems(List=pořadí, Item=list_item_6, Indices=dispatch.ListA, Wrap=False)
replace_items_2 = ReplaceItems(List=replace_items, Item=list_item_4, Indices=dispatch_2.ListA, Wrap=False)
replace_items_3 = ReplaceItems(List=pořadí, Item=brick_material, Indices=dispatch.ListA, Wrap=False)
replace_items_4 = ReplaceItems(List=replace_items_2, Item=list_item_3, Indices=dispatch_3.ListA, Wrap=False)
replace_items_5 = ReplaceItems(List=replace_items_3, Item=brick_material_r, Indices=dispatch_2.ListA, Wrap=False)
replace_items_6 = ReplaceItems(List=replace_items_4, Item=list_item_5, Indices=dispatch_4.ListA, Wrap=False)
replace_items_7 = ReplaceItems(List=replace_items_5, Item=brick_material_k_2, Indices=dispatch_3.ListA, Wrap=False)
replace_items_8 = ReplaceItems(List=replace_items_7, Item=brick_material_k, Indices=dispatch_4.ListA, Wrap=False)

# ---- group: Points of simulation
crv = Curve([<curve referenced from the Rhino model> x7])
coords = ImportCoordinates(File="../../../data/points/all_points.csv", Separator=",", XIndex=0, YIndex=1, ZIndex=2)
number_points_2 = Slider(1, range=0..1000000)

# ---- group: Podstavec Robota
délka_podstavce = Slider(1450, range=-10000..10000)
výška_podstavce = Slider(1000, range=-10000..10000)
šířka_podstavce = Slider(1450, range=-10000..10000)
division_39 = Division(A=šířka_podstavce, B=-2)
division_40 = Division(A=šířka_podstavce, B=2)
division_41 = Division(A=délka_podstavce, B=-2)
division_42 = Division(A=délka_podstavce, B=2)
construct_domain_20 = ConstructDomain(DomainStart=division_39, DomainEnd=division_40)
construct_domain_21 = ConstructDomain(DomainStart=division_41, DomainEnd=division_42)
unit_z_13 = UnitZ(Factor=výška_podstavce)

# ---- group: Base Points
y_base_robota = Slider(2420, range=-10000..10000)
x_base_robota = Slider(2250, range=-10000..10000)
vec = VectorXYZ(XComponent=x_base_robota, YComponent=y_base_robota, ZComponent=výška_podstavce)  # -> Vector, Length
robot_base_point = ConstructPoint(XCoordinate=x_base_robota, YCoordinate=y_base_robota, ZCoordinate=výška_podstavce)
zero_point = ConstructPoint(XCoordinate=x_base_robota, YCoordinate=y_base_robota, ZCoordinate=0)

# ---- group: Points of simulation (continued)
move_18 = Move(Geometry=crv, Motion=vec.Vector)  # -> Geometry, Transform
ln = Line(StartPoint=zero_point, EndPoint=robot_base_point)
revsrf = Revolution(Curve=move_18.Geometry, Axis=ln, Domain=Domain(0, 6.283185307))
sunion = SolidUnion(Breps=revsrf)
bvol = BoundaryVolume(Boundaries=revsrf)
pop3d_2 = Populate3D(Region=sunion, Count=number_points_2, Seed=1)
brepinc = PointInBrep(Brep=bvol, Point=pop3d_2, Strict=False)
brepinc_2 = PointInBrep(Brep=sunion, Point=pop3d_2, Strict=False)
not = GateNot(A=brepinc)
and = GateAnd(A=brepinc_2, B=not)
dispatch_9 = Dispatch(List=pop3d_2, DispatchPattern=and)  # -> ListA, ListB
pt_5 = Point(dispatch_9.ListA)
panel_4 = Panel(pt_5)

# ---- group: Podstavec Robota (continued)
podstavec_7 = Rectangle(Plane=zero_point, XSize=construct_domain_20, YSize=construct_domain_21, Radius=0)  # -> Rectangle, Length
extrude_10 = Extrude(Base=podstavec_7.Rectangle, Direction=unit_z_13)
cap_holes_ex_10 = CapHolesEx(Brep=extrude_10)  # -> Brep, Caps, Solid
custom_preview_9 = CustomPreview(Geometry=cap_holes_ex_10.Brep, Material=concrete)

# ---- group: Robot
import_3dm = Import3DM(File="./Tool/Grip-Super-easy-3.3dm", Layer="*", Name="*")
xz_plane = XZPlane(Origin=Point(0, 0, 0))
rotate_2 = Rotate(Geometry=import_3dm, Angle=3.141592654, Plane=xz_plane)  # -> Geometry, Transform
rotate_3 = Rotate(Geometry=rotate_2.Geometry, Angle=-1.570796327, Plane=PlaneXY(0, 0, 0))  # -> Geometry, Transform
move_19 = Move(Geometry=rotate_3.Geometry, Motion=Vector(0, 0, -35))  # -> Geometry, Transform
custom_tool_kuka_prc = CustomToolKUKAPrc(
    CustomToolGeometry=move_19.Geometry,
    isExternal=False,
    toolid=1,
    toolvala=-90,
    toolvalb=-90,
    toolvalc=0,
    toolvalx=-90,
    toolvaly=0,
    toolvalz=230,
    valuesset=True)
quantec_kr120_r3900k_robot = QuantecKR120R3900KRobot(infiniterot=False)

# ---- group: Pohyby robota
integer = Integer(přísavka)
integer_2 = Integer(vrstva)
vystředění_přisavky = Slider(126, range=0..500)
dotlačení_tvarovky_z = Slider(150, range=0..1000)
dotlačení_tvarovky = Slider(50, range=0..1000)
evaluate_box_5 = EvaluateBox(Box=replace_items_6, UParameter=0.5, VParameter=0.5, WParameter=0.5)  # -> Plane, Point, Include
multiplication_8 = Multiplication(A=integer_2, B=250)
expression = Expression(p=integer, Expression="If (p=1, -90, If (p=2, 0, If (p=3, 0, -90)))")
expression_2 = Expression(p=integer, d=vystředění_přisavky, Expression="If (p=1, d, If (p=2, 0, If (p=3, -d, 0)))")
expression_3 = Expression(p=integer, d=vystředění_přisavky, Expression="If (p=1, 0, If (p=2, -d, If (p=3, 0, d)))")
expression_4 = Expression(p=integer, d=dotlačení_tvarovky, Expression="If (p=1, d, If (p=2, 0, If (p=3, -d, 0)))")
expression_5 = Expression(p=integer, d=dotlačení_tvarovky, Expression="If (p=1, 0, If (p=2, -d, If (p=3, 0, d)))")
expression_6 = Expression(x=multiplication_8, Expression="If (x>2500,x,2500)")
deconstruct = Deconstruct(Point=evaluate_box_5.Point)  # -> XComponent, YComponent, ZComponent
move_20 = Move(Geometry=evaluate_box_5.Plane, Motion=Vector(0, -126, 0))  # -> Geometry, Transform
evaluate_box_6 = EvaluateBox(Box=split_list.Geometrie, UParameter=0.5, VParameter=0.5, WParameter=0.5)  # -> Plane, Point, Include
rotate_plane = RotatePlane(Plane=move_20.Geometry, Angle=1.570796327)
construct_point_5 = ConstructPoint(XCoordinate=1800, YCoordinate=2000, ZCoordinate=expression_6)
subtraction_12 = Subtraction(A=2500, B=deconstruct.ZComponent)
radians_2 = Radians(Degrees=expression)
vector_xyz = VectorXYZ(XComponent=expression_4, YComponent=expression_5, ZComponent=dotlačení_tvarovky_z)  # -> Vector, Length
vector_xyz_2 = VectorXYZ(XComponent=expression_2, YComponent=expression_3, ZComponent=0)  # -> Vector, Length
x_refer = Slider(500, range=-10000..10000)
y_refer = Slider(2450, range=-10000..10000)
z_refer = Slider(1500, range=0..10000)
vector_xyz_3 = VectorXYZ(XComponent=0, YComponent=-50, ZComponent=subtraction_12)  # -> Vector, Length
xz_plane_2 = XZPlane(Origin=construct_point_5)
move_21 = Move(Geometry=evaluate_box_6.Plane, Motion=vector_xyz_2.Vector)  # -> Geometry, Transform
construct_point_6 = ConstructPoint(XCoordinate=x_refer, YCoordinate=y_refer, ZCoordinate=z_refer)
rotate_plane_2 = RotatePlane(Plane=move_21.Geometry, Angle=radians_2)
move_22 = Move(Geometry=rotate_plane, Motion=vector_xyz_3.Vector)  # -> Geometry, Transform
distance_2 = Distance(PointA=move_22.Geometry, PointB=rotate_plane)
distance_3 = Distance(PointA=rotate_plane, PointB=move_22.Geometry)
distance_4 = Distance(PointA=move_22.Geometry, PointB=xz_plane_2)
distance_5 = Distance(PointA=move_22.Geometry, PointB=xz_plane_2)
move_23 = Move(Geometry=rotate_plane_2, Motion=vector_xyz.Vector)  # -> Geometry, Transform
distance_6 = Distance(PointA=xz_plane_2, PointB=move_23.Geometry)
distance_7 = Distance(PointA=move_23.Geometry, PointB=rotate_plane_2)
distance_8 = Distance(PointA=rotate_plane_2, PointB=move_23.Geometry)
distance_9 = Distance(PointA=move_23.Geometry, PointB=xz_plane_2)
addition_4 = Addition(A=distance_2, B=distance_3, C=distance_4, D=distance_6, E=distance_7, F=distance_8, G=distance_9, H=distance_5)
mass_addition_5 = MassAddition(Input=addition_4)  # -> Result, PartialResults
dráha_robota_mm = Panel(addition_4)
division_43 = Division(A=mass_addition_5.Result, B=1000)  # -> flatten(Result)
celková_dráha_m = Panel(division_43)

# ----
repeat = RepeatData(Data=construct_point_6, Length=konec_vrstvy)
xy = XYPlane(Origin=repeat)
prot = RotatePlane(Plane=xy, Angle=3.141592654)
weave = Weave(Pattern=[0, 1], Stream0=prot, Stream1=rotate_plane_2, NullGaps=False)
ptp_move = PTPMovementKUKAPrc(TargetAsPlane=weave, extaxenabled=False, interpolation="C_PTP")

# ---- group: Pohyby robota (continued)
linear_movement_kuka_prc = LINearMovementKUKAPrc(TargetAsPlane=weave, extaxenabled=False, interpolation="C_DIS")
distance_10 = Distance(PointA=prot, PointB=rotate_plane_2)
command_weaver_kuka_prc = CommandWeaverKUKAPrc(Command1=ptp_move, enabletree=False)
panel_5 = Panel(command_weaver_kuka_prc)

# ---- group: Robot (continued)
kuka_prc_core = KUKAPrcCORE(
    SimulationSlider=Slider(1, range=0..1),
    KUKAPrcCommands=command_weaver_kuka_prc,
    Tool=custom_tool_kuka_prc,
    Robot=quantec_kr120_r3900k_robot,
    PRC_BaseExpose=False,
    PRC_SaveNameExpose=False,
    PRCsettings="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")  # -> RobotGeometry, AnalysisOutput

# ----
panel_6 = Panel(weave)
panel_7 = Panel(distance_10)
